# Grasshopper definition TTC_Workflow_V1.gh (Grasshopper 1.0.8)
# plug-ins: Karamba3D

# ----
# INPUT for LLM:
# 
# "You can choose from this list of Crosssections"
crosecrselect = CrossSectionRangeSelectorKaramba3D(MaximumHeight_cm=-1, MaximumWidth_cm=-1, menu=[dropdown(1), dropdown(1), dropdown(2), dropdown(0)])
panel = Panel(crosecrselect)
item = ListItem(List=crosecrselect, Index=Slider(0, range=0..50), Wrap=True)

ttc_send_prompt = Python3Script(prompt="Create a Warren Truss spanning 5 metres.", arm=Toggle(True), run=Button())  # -> run_id, run_commentary, communication; inputs prompt: String, arm: Boolean, run: Boolean
# ---------- ttc_send_prompt: Python ----------
# GH component 1: Send user prompt to interpreter and start the pipeline.
# Copy-paste into a GHPython component in TTC_Workflow_V1.gh.
# Runs only when you hit Run (Button); not on file reload. Use arm to enable/disable.
#
# GHPython (CPython 3, Rhino 8):
#   Input  prompt: str — user prompt (e.g. "gable truss 12 m span, steel")
#   Input  run:    wire Button — click to run pipeline (only when armed)
#   Input  arm:    bool — True = armed (can run), False = disarmed (no run)
#   Output communication: str — ONLY the chat completion (LLM message; no errors)
#   Output run_id: str — for fetch-output component
#   Output run_commentary: str — step log + all error messages

import os
import sys
from pathlib import Path

# Hardcode repo root so 03_python is always found when pasted into GH (Rhino cwd/__file__ are unreliable)
REPO_ROOT = r"C:\Users\levin\Documents\GitHub\gh-text-to-code-ai-integration"
# Fallback if you moved the project: try cwd
if not os.path.isdir(os.path.join(REPO_ROOT, "03_python")):
    _cwd = Path(os.getcwd()).resolve()
    if (_cwd / "03_python").is_dir():
        REPO_ROOT = str(_cwd)
    elif _cwd.name == "02_grasshopper" and (_cwd.parent / "03_python").is_dir():
        REPO_ROOT = str(_cwd.parent)

SCRIPTS_DIR = os.path.join(REPO_ROOT, "03_python")
if SCRIPTS_DIR not in sys.path:
    sys.path.insert(0, SCRIPTS_DIR)
os.environ["TTC_03_PYTHON"] = os.path.abspath(SCRIPTS_DIR)

_env_path = os.path.join(REPO_ROOT, "00_setup", ".env")
if os.path.isfile(_env_path):
    try:
        from dotenv import load_dotenv
        load_dotenv(_env_path)
    except ImportError:
        pass
    if not (os.environ.get("ANTHROPIC_API_KEY") or os.environ.get("CLAUDE_API_KEY")):
        with open(_env_path) as _f:
            for _line in _f:
                _line = _line.strip()
                if _line and not _line.startswith("#") and "=" in _line:
                    _k, _, _v = _line.partition("=")
                    _k, _v = _k.strip(), _v.strip()
                    if _v.startswith('"') and _v.endswith('"'): _v = _v[1:-1]
                    elif _v.startswith("'") and _v.endswith("'"): _v = _v[1:-1]
                    if _k:
                        os.environ.setdefault(_k, _v)

from ttc_main import run as run_pipeline, load_latest_outputs

# Only run pipeline when armed and run is triggered and prompt is non-empty
armed = bool(arm) if arm is not None else False
run_triggered = bool(run) if run is not None else False
prompt_text = str(prompt).strip() if prompt else ""

do_run = armed and run_triggered and bool(prompt_text)

if do_run:
    try:
        out = run_pipeline(prompt_text, run_id=None)
        communication = out.get("communication", "")
        run_id = out.get("run_id", "")
        run_commentary = out.get("run_commentary", "")
    except Exception as e:
        communication = ""
        run_id = ""
        run_commentary = "Error: {}".format(e)
else:
    # Display latest run so results persist after button pulse
    run_id, communication, run_commentary = load_latest_outputs()
    if not run_id:
        if not armed:
            run_commentary = "Disarmed. Set arm = True and click Run to start pipeline."
        elif not run_triggered:
            run_commentary = "Armed. Click Run to start."
        elif not prompt_text:
            run_commentary = "No prompt provided. Enter prompt and click Run."
        else:
            run_commentary = ""
# ---------- end ttc_send_prompt ----------
panel_2 = Panel(ttc_send_prompt.run_id)
panel_3 = Panel(ttc_send_prompt.run_commentary)
panel_4 = Panel(ttc_send_prompt.communication)
ttc_fetch_output = Python3Script(run_id=panel_2)  # -> status, Line_Elements, Support, Loads, Load_Points; inputs run_id: String
# ---------- ttc_fetch_output: Python ----------
# GH component 2: Fetch run output (geometric_output.json) for a run_id.
# Copy-paste into a GHPython component in TTC_Workflow_V1.gh.
# Loads run_output/[run_id]/geometric_output.json (2D [x,z], y=0).
#
# GHPython (CPython 3, Rhino 8):
#   Input  run_id: str — wire from send-prompt component (output run_id)
#   Output status: str (OK or message)
#   Output Line_Elements: list of Rhino.Geometry.Line
#   Output Support: list of Rhino.Geometry.Point3d (support points)
#   Output Loads: list of Rhino.Geometry.Vector3d (force vectors, kN)
#   Output Load_Points: list of Rhino.Geometry.Point3d (application points)

import os
import sys
from pathlib import Path

# Hardcode repo root so 03_python is always found when pasted into GH (Rhino cwd/__file__ are unreliable)
REPO_ROOT = r"C:\Users\levin\Documents\GitHub\gh-text-to-code-ai-integration"
if not os.path.isdir(os.path.join(REPO_ROOT, "03_python")):
    _cwd = Path(os.getcwd()).resolve()
    if (_cwd / "03_python").is_dir():
        REPO_ROOT = str(_cwd)
    elif _cwd.name == "02_grasshopper" and (_cwd.parent / "03_python").is_dir():
        REPO_ROOT = str(_cwd.parent)

SCRIPTS_DIR = os.path.join(REPO_ROOT, "03_python")
if SCRIPTS_DIR not in sys.path:
    sys.path.insert(0, SCRIPTS_DIR)
os.environ["TTC_03_PYTHON"] = os.path.abspath(SCRIPTS_DIR)

from ttc_main import load_geometric_output

try:
    import Rhino.Geometry as rg
except ImportError:
    rg = None

# 2D [x, z] → Rhino Point3d with y=0
def _pt(xz):
    if xz is None or len(xz) < 2:
        return None
    return rg.Point3d(float(xz[0]), 0.0, float(xz[1]))


def _parse_geometric_to_gh(geo):
    """Parse geometric_output.json into GH elements. Plane [x,z], y=0. Uses Rhino.Geometry."""
    line_elements = []
    support = []
    loads = []
    load_points = []

    if not geo or not rg:
        return line_elements, support, loads, load_points

    for seg in geo.get("line_elements") or []:
        s, e = seg.get("start"), seg.get("end")
        ps, pe = _pt(s), _pt(e)
        if ps and pe:
            line_elements.append(rg.Line(ps, pe))

    for xz in geo.get("support") or []:
        p = _pt(xz)
        if p:
            support.append(p)

    for ld in geo.get("loads") or []:
        if not ld or len(ld) < 3:
            continue
        x, z, F = float(ld[0]), float(ld[1]), float(ld[2])
        load_points.append(rg.Point3d(x, 0.0, z))
        loads.append(rg.Vector3d(0.0, 0.0, F))

    return line_elements, support, loads, load_points


run_id_str = str(run_id).strip() if run_id else ""
if not run_id_str:
    status = "No run_id provided. Run the send-prompt component first and wire its run_id output here."
    Line_Elements = []
    Support = []
    Loads = []
    Load_Points = []
else:
    try:
        geo = load_geometric_output(run_id_str)
        status = "OK"
        Line_Elements, Support, Loads, Load_Points = _parse_geometric_to_gh(geo)
    except Exception as err:
        status = str(err)
        Line_Elements, Support, Loads, Load_Points = [], [], [], []
# ---------- end ttc_fetch_output ----------
panel_5 = Panel(ttc_fetch_output.status)

# ----
# Karamba Analysis Workflow
line_elements = Data(ttc_fetch_output.Line_Elements)
support_points = Data(ttc_fetch_output.Support)
loads = Data(ttc_fetch_output.Loads)
crosec = Data(item)
load_points = Data(ttc_fetch_output.Load_Points)

crosecselect = CrossSectionSelectorKaramba3D(CrossSections=crosec)  # -> CrossSection, Info
supp = SupportKaramba3D(PosInd=support_points, Ct_kN_m=Vector(0, 0, 0), Cr_kNm_rad=Vector(0, 0, 0), menu=[buttons(on, on, on, on, on, on)])
loads_2 = LoadsKaramba3D(ForceVector=loads, Local=False, PosInd=load_points, LCase="LC0", mode="Point")
loads_3 = LoadsKaramba3D(Vector=Vector(0, 0, -1), LCase="LC0", mode="Gravity")
lineelem = CreateLinearElementKaramba3D(
    Line=line_elements,
    CrossSection=crosecselect.CrossSection,
    LimitDistance_m=0.005,
    BucklingLengthY_m=-1,
    BucklingLengthZ_m=-1,
    BucklingLengthLT_m=-1,
    Bending=True,
    ToPolylineMaxAngle=0.25,
    ToPolylineTolerance=0.1,
    ToPolylineMaxEdgeLength=0.25,
    New=True,
    Remove=True,
    mode="LineToBeam",
    GuidGeneratorSeed=-236662677)  # -> Element, Points, Info
merge = Merge(Data1=loads_2, Data2=loads_3)  # -> flatten(Result)

assemble = AssembleModelKaramba3D(Elem=lineelem.Element, Support=supp, Load=merge, LimitDistance_m=0.005)  # -> Model, Info, Mass_kg, CentreOfGravity, LoadCaseNames
analyse = AnalyseKaramba3D(Model=assemble.Model)  # -> AnalysedModel, MaximumDisplacement_cm, ResultingForce_kN, ChangeOfElasticEnergy_kNm
modelview = ModelViewKaramba3D(Model=analyse.AnalysedModel)  # -> Model, DeformedMesh, DeformedAxes, DeformedModel, MaximumDeformation
beamview = BeamViewKaramba3D(Model=modelview.Model)  # -> Model, MeshesOfRenderedBeams, DeformedBeamAxes, LegendColours, LegendTags
legend = LegendKaramba3D(
    Colors=beamview.LegendColours,
    Tags=beamview.LegendTags,
    Scale=0.8,
    Textsize=30,
    Legend_HasHeader=False,
    Legend_Justification=2,
    Legend_Position=2)

# ----
# Test Geometry
_01_test_geometry = _01_Test_Geometry()
load_point_selection = Load_Point_Selection(C=_01_test_geometry)
support_selection = Support_Selection(C=_01_test_geometry)
data = Data(_01_test_geometry)
data_2 = Data(support_selection)
data_3 = Data(load_point_selection)

lng = ListLength(List=load_point_selection)
neg = Negative(Value=Slider(50, range=0..100))
dup = DuplicateData(Data=neg, Number=lng, Order=True)
Z = UnitZ(Factor=dup)

loads_4 = Data(Z)

# ==== cluster _01_Test_Geometry
pipeline = GeometryPipeline(
    GroupByLayer=False,
    GroupByType=False,
    IncludeHidden=True,
    IncludeLocked=True,
    LayerFilter="01__Text Geometry",
    NameFilter="*",
    SublayerFiltering=True,
    TypeFilter=4)
split = SplitList(List=pipeline, Index="1")  # -> ListA, ListB
clx = CurveLine(Curve=split.ListA, Line=split.ListB)  # -> flatten(Points), flatten(Params), Count
cullpt = CullDuplicates(Points=clx.Points, Tolerance=0.1, CullMode=1)  # -> Points, Indices, Valence
item = ListItem(List=clx.Params, Index=cullpt.Indices, Wrap=True)
shatter = Shatter(Curve=split.ListA, Parameters=item)  # -> flatten(Segments)
explode = Explode(Curve=shatter, Recursive=True)  # -> flatten(Segments), Vertices
data = Data(split.ListB)
merge = Merge(Data1=explode.Segments, Data2=data)  # -> flatten(Line_Elements)
line_elements = ClusterOutput(merge)

# ==== cluster Load_Point_Selection
C = ClusterInput()
end = EndPoints(Curve=C)  # -> Start, End
merge = Merge(Data1=end.Start, Data2=end.End)  # -> flatten(Result)
rdpoints = RemoveDuplicatePointsKaramba3D(Point=merge, LimitDistance=0.005)  # -> OutPoint, Info, Indexes
pdecon = Deconstruct(Point=rdpoints.OutPoint)  # -> XComponent, YComponent, ZComponent
larger = LargerThan(FirstNumber=pdecon.ZComponent, SecondNumber=Slider(3.37, range=0..10))  # -> LargerThan, OrEqualTo
cull = CullPattern(List=rdpoints.OutPoint, CullPattern=larger.LargerThan)
loads_top_chord = ClusterOutput(cull)

# ==== cluster Support_Selection
C = ClusterInput()
end = EndPoints(Curve=C)  # -> Start, End
merge = Merge(Data1=end.Start, Data2=end.End)  # -> flatten(Result)
rdpoints = RemoveDuplicatePointsKaramba3D(Point=merge, LimitDistance=0.005)  # -> OutPoint, Info, Indexes
pdecon = Deconstruct(Point=rdpoints.OutPoint)  # -> XComponent, YComponent, ZComponent
larger = LargerThan(FirstNumber=pdecon.ZComponent, SecondNumber=Slider(3.37, range=0..10))  # -> LargerThan, OrEqualTo
cull = CullPattern(List=rdpoints.OutPoint, CullPattern=invert(larger.LargerThan))
pdecon_2 = Deconstruct(Point=cull)  # -> XComponent, YComponent, ZComponent
sort = SortList(Keys=pdecon_2.XComponent, ValuesA=cull)  # -> Keys, ValuesA
panel = Panel("""0
-1""")
item = ListItem(List=sort.ValuesA, Index=panel, Wrap=True)  # -> flatten(Item)
i = ClusterOutput(item)
