# Grasshopper definition TTC_Workflow_V2.gh (Grasshopper 1.0.8)
# plug-ins: Karamba3D

# ----
# CroSec Catalogue
# INPUT for LLM:
# 
# "You can choose from this list of Crosssections"
crosecrselect = CrossSectionRangeSelectorKaramba3D(MaximumHeight_cm=-1, MaximumWidth_cm=-1, menu=[dropdown(1), dropdown(1), dropdown(2), dropdown(0)])

list = ValueList({"NEW TRUSS": 0, "ITERATION": 1}, selected="ITERATION")

# ----
# Chat Input / User Prompt: Bowstring with 10 Bays
# 
# For a roof of 15 x 30 metres and a weight of 10 kN/m².
# Agent Communication
chat_input_user_prompt = Panel("Optimize the Cross sections. Lower the stress/strength ratio")
ttc_post_run_pipeline = Python3Script(prompt=chat_input_user_prompt, arm=Toggle(True), run=Button(), mode=list, CroSec=crosecrselect)  # -> run_id; inputs api_key: String, prompt: String, arm: Boolean, run: Boolean, mode: Int32, CroSec: list
# ---------- ttc_post_run_pipeline: Python ----------
# GH component: TTC Run Pipeline
# Copy-paste into a GHPython component. Runs only when Run is clicked (armed + button + prompt).
# Output run_id connects to the next component in the chain (e.g. TTC Fetch Interpreter Returns).
#
# GHPython (CPython 3, Rhino 8):
#   Input  prompt: str — user prompt (e.g. "gable truss 12 m span, steel")
#   Input  CroSec: str or list — cross-section catalogue. Either a single string with lines like
#           family:'HEA' name:'HEA100' country:'EU' material:'Steel' applies to elements:''; 
#           or a list of profile name strings (e.g. ["HEA100","HEA120",...]). Used by Generator to assign one profile per member.
#   Input  mode:   int — 0 = NEW TRUSS (default), 1 = ITERATION. In ITERATION mode, files from the latest run_output
#           are loaded and added as context for both interpreter and generator.
#   Input  api_key: str — Claude API key. Used only if .env does not set ANTHROPIC_API_KEY/CLAUDE_API_KEY.
#   Input  run:    wire Button — click to run pipeline (only when armed). Runs once per pulse (rising edge).
#   Input  arm:    bool — True = armed, False = disarmed
#   Output run_id: str — pass to next component in chain

import os
import re
import sys
from pathlib import Path

# State file for rising-edge detection: run pipeline only when run goes False → True (one API run per click).
_TTC_RUN_STATE_FILE = None  # set after REPO_ROOT is defined


def _run_trigger_rising_edge(run_val):
    """Return True only when run_val is True this time and was False last time (single run per button click)."""
    global _TTC_RUN_STATE_FILE
    if _TTC_RUN_STATE_FILE is None:
        return bool(run_val)  # fallback if state file not set
    try:
        prev = _TTC_RUN_STATE_FILE.read_text().strip().lower() == "true"
    except Exception:
        prev = False
    is_run = bool(run_val)
    try:
        _TTC_RUN_STATE_FILE.write_text("True" if is_run else "False", encoding="utf-8")
    except Exception:
        pass
    return is_run and not prev


def _parse_crosec_catalog(crosec_input):
    """Parse CroSec input to a list of profile name strings. Handles GH catalogue string format or list of names."""
    if crosec_input is None:
        return []
    if hasattr(crosec_input, "__iter__") and not isinstance(crosec_input, str):
        # List of items from GH (e.g. list of strings)
        try:
            items = list(crosec_input)
            if not items:
                return []
            # If first item looks like "family:'HEA' name:'HEA100' ...", parse each
            first = str(items[0])
            if "name:'" in first or 'name:"' in first:
                names = []
                for item in items:
                    s = str(item).strip()
                    m = re.search(r"name:\s*['\"]([^'\"]+)['\"]", s)
                    if m:
                        names.append(m.group(1))
                return names
            # Otherwise treat as list of profile names
            return [str(x).strip() for x in items if str(x).strip()]
        except (TypeError, IndexError):
            return []
    s = str(crosec_input).strip()
    if not s:
        return []
    names = []
    for line in s.replace(";", "\n").splitlines():
        line = line.strip()
        if not line:
            continue
        m = re.search(r"name:\s*['\"]([^'\"]+)['\"]", line)
        if m:
            names.append(m.group(1))
    return names

REPO_ROOT = r"C:\Users\levin\Documents\GitHub\gh-text-to-code-ai-integration"
if not os.path.isdir(os.path.join(REPO_ROOT, "03_python")):
    _cwd = Path(os.getcwd()).resolve()
    if (_cwd / "03_python").is_dir():
        REPO_ROOT = str(_cwd)
    elif _cwd.name == "02_grasshopper" and (_cwd.parent / "03_python").is_dir():
        REPO_ROOT = str(_cwd.parent)

# Rising-edge state file (run only once per button click)
_TTC_RUN_STATE_FILE = Path(REPO_ROOT) / ".ttc_gh_run_prev"

SCRIPTS_DIR = os.path.join(REPO_ROOT, "03_python")
if SCRIPTS_DIR not in sys.path:
    sys.path.insert(0, SCRIPTS_DIR)
os.environ["TTC_03_PYTHON"] = os.path.abspath(SCRIPTS_DIR)

_env_path = os.path.join(REPO_ROOT, "00_setup", ".env")
if os.path.isfile(_env_path):
    try:
        from dotenv import load_dotenv
        load_dotenv(_env_path)
    except ImportError:
        pass
    if not (os.environ.get("ANTHROPIC_API_KEY") or os.environ.get("CLAUDE_API_KEY")):
        with open(_env_path) as _f:
            for _line in _f:
                _line = _line.strip()
                if _line and not _line.startswith("#") and "=" in _line:
                    _k, _, _v = _line.partition("=")
                    _k, _v = _k.strip(), _v.strip()
                    if _v.startswith('"') and _v.endswith('"'): _v = _v[1:-1]
                    elif _v.startswith("'") and _v.endswith("'"): _v = _v[1:-1]
                    if _k:
                        os.environ.setdefault(_k, _v)

from ttc_main import run as run_pipeline, get_latest_run_id

armed = bool(arm) if arm is not None else False
run_val = bool(run) if run is not None else False
run_triggered = _run_trigger_rising_edge(run_val)  # True only on rising edge (one run per click)
prompt_text = str(prompt).strip() if prompt else ""
try:
    crosec_catalog = _parse_crosec_catalog(CroSec) if CroSec is not None else []
except NameError:
    crosec_catalog = []  # CroSec input not yet added to component
try:
    mode_val = int(mode) if mode is not None else 0
except (TypeError, ValueError):
    mode_val = 0
if mode_val not in (0, 1):
    mode_val = 0
api_key_str = str(api_key).strip() if api_key is not None else ""

do_run = armed and run_triggered and bool(prompt_text)

if do_run:
    try:
        out = run_pipeline(prompt_text, run_id=None, cross_section_catalog=crosec_catalog, mode=mode_val, api_key=api_key_str or None)
        run_id = out.get("run_id", "")
    except Exception as e:
        run_id = ""
else:
    # When not running, pass through latest run_id so the chain still has a value
    run_id = get_latest_run_id() or ""
# ---------- end ttc_post_run_pipeline ----------
ttc_get_interpreter = Python3Script(run_id=ttc_post_run_pipeline)  # -> run_id, run_commentary, communication; inputs run_id: String
# ---------- ttc_get_interpreter: Python ----------
# GH component: TTC Fetch Interpreter Returns
# Input run_id → output run_id (pass-through). Reads communication.txt and run_commentary.txt from run_output.
# Outputs one string each (newlines collapsed to space) so Panel shows a single item.
#
# Input  run_id: str
# Output run_id: str (same as input)
# Output communication: str
# Output run_commentary: str

REPO_ROOT = r"C:\Users\levin\Documents\GitHub\gh-text-to-code-ai-integration"
RUN_OUTPUT_DIR = REPO_ROOT + r"\03_python\run_output"

run_id = str(run_id).strip() if run_id else ""

communication = ""
run_commentary = ""
if run_id:
    base = RUN_OUTPUT_DIR + "\\" + run_id
    try:
        with open(base + "\\communication.txt", encoding="utf-8") as f:
            communication = f.read()
        # Collapse newlines to space so GH Panel shows one string, not a list of lines
        communication = " ".join(communication.split())
    except Exception:
        pass
    try:
        with open(base + "\\run_commentary.txt", encoding="utf-8") as f:
            run_commentary = f.read()
        run_commentary = " ".join(run_commentary.split())
    except Exception:
        pass
# ---------- end ttc_get_interpreter ----------
chat_output = Panel(ttc_get_interpreter.communication)
run_id = Panel(ttc_get_interpreter.run_id)
panel = Panel(ttc_get_interpreter.run_commentary)

ttc_get_executor = Python3Script(run_id=run_id)  # -> run_id, status, Line_Elements, CroSec, Support, Loads, Load_Points; inputs run_id: String
# ---------- ttc_get_executor: Python ----------
# GH component: TTC Fetch Executor (geometric_output.json).
# Input run_id → output run_id (pass-through). Reads geometric_output.json from run_output, parses to GH geometry.
# Structure follows config/geometric_outline.json: line_elements (start, end, cross_section), support, loads.
#
# Input  run_id: str (or list with one str from GH wire)
# Output run_id: str (same as input)
# Output status: str
# Output Line_Elements, Support, Loads, Load_Points, CroSec
#   CroSec: list of cross_section name strings, one per line element (same order as Line_Elements)

import json
import os

REPO_ROOT = r"C:\Users\levin\Documents\GitHub\gh-text-to-code-ai-integration"
RUN_OUTPUT_DIR = os.path.join(REPO_ROOT, "03_python", "run_output")

try:
    import Rhino.Geometry as rg
except ImportError:
    rg = None

# GH may pass a list; take first element so path is a plain string
if run_id is not None and hasattr(run_id, "__getitem__") and not isinstance(run_id, str):
    try:
        run_id = run_id[0]
    except (IndexError, TypeError, KeyError):
        run_id = ""
run_id = str(run_id).strip() if run_id else ""

if not run_id:
    status = "No run_id provided."
    Line_Elements = []
    Support = []
    Loads = []
    Load_Points = []
    CroSec = []
else:
    path = os.path.join(RUN_OUTPUT_DIR, run_id, "geometric_output.json")
    status = "OK"
    Line_Elements = []
    Support = []
    Loads = []
    Load_Points = []
    CroSec = []
    try:
        with open(path, encoding="utf-8") as f:
            geo = json.load(f)
        line_elems = geo.get("line_elements") or []
        if rg:
            for seg in line_elems:
                s, e = seg.get("start"), seg.get("end")
                if s and e and len(s) >= 2 and len(e) >= 2:
                    Line_Elements.append(rg.Line(rg.Point3d(s[0], 0.0, s[1]), rg.Point3d(e[0], 0.0, e[1])))
                CroSec.append(str(seg.get("cross_section") or ""))
            for xz in geo.get("support") or []:
                if xz and len(xz) >= 2:
                    Support.append(rg.Point3d(xz[0], 0.0, xz[1]))
            for ld in geo.get("loads") or []:
                if ld and len(ld) >= 3:
                    Load_Points.append(rg.Point3d(ld[0], 0.0, ld[1]))
                    Loads.append(rg.Vector3d(0.0, 0.0, ld[2]))
        else:
            for seg in line_elems:
                CroSec.append(str(seg.get("cross_section") or ""))
    except Exception as err:
        status = str(err)
# ---------- end ttc_get_executor ----------

# ----
# View Truss Plot
toggle = BooleanToggle(False)
ttc_get_display_truss = Python3Script(run_id=ttc_get_executor.run_id, show=toggle)  # -> status; inputs run_id: String, show: Boolean
# ---------- ttc_get_display_truss: Python ----------
# GHPython Component: Display Truss Plot Image
# --------------------------------------------
# Repo: 03_python/run_output/{run_id}/truss_plot.png
#
# Inputs:  run_id (str), show (bool)
# Outputs: status (str), resolved_path (str)

import os
import clr
clr.AddReference("System.Drawing")
import System.Drawing as SD
import Rhino
import Rhino.Display as RD
import Rhino.Geometry as RG
import scriptcontext as sc

IMG_WIDTH = 1200
MARGIN_LEFT = 10
MARGIN_TOP = 10
CONDUIT_KEY = "ttc_truss_plot_conduit"

# ---- Repo root (same as other gh_python scripts) ----
REPO_ROOT = r"C:\Users\levin\Documents\GitHub\gh-text-to-code-ai-integration"
if not os.path.isdir(os.path.join(REPO_ROOT, "03_python")):
    from pathlib import Path
    _cwd = Path(os.getcwd()).resolve()
    if (_cwd / "03_python").is_dir():
        REPO_ROOT = str(_cwd)
    elif _cwd.name == "02_grasshopper" and (_cwd.parent / "03_python").is_dir():
        REPO_ROOT = str(_cwd.parent)

# ---- Normalize run_id (can be list from GH wire) ----
if run_id is not None and hasattr(run_id, "__getitem__") and not isinstance(run_id, str):
    try:
        run_id = run_id[0]
    except (IndexError, TypeError, KeyError):
        run_id = ""
run_id = str(run_id).strip() if run_id else ""

img_path = os.path.join(REPO_ROOT, "03_python", "run_output", run_id, "truss_plot.png")
resolved_path = os.path.abspath(img_path)

if not run_id:
    status = "ERROR: No run_id provided."
elif not os.path.isfile(img_path):
    status = "ERROR: File not found:\n{}".format(resolved_path)
else:
    try:
        bmp = SD.Bitmap(img_path)
        w, h = float(bmp.Width), float(bmp.Height)
        draw_w = float(IMG_WIDTH)
        draw_h = draw_w * (h / w) if w else draw_w

        # DisplayBitmap for the display pipeline (keep bitmap ref so it isn't GC'd)
        display_bmp = RD.DisplayBitmap(bmp)

        if CONDUIT_KEY not in sc.sticky:
            class TrussPlotConduit(RD.DisplayConduit):
                def __init__(self):
                    self.visible = False
                    self.display_bmp = None
                    self.bitmap_ref = None
                    self.center_x = 0.0
                    self.center_y = 0.0
                    self.draw_w = 0.0
                    self.draw_h = 0.0

                def DrawForeground(self, e):
                    if not self.visible or self.display_bmp is None:
                        return
                    center = RG.Point2d(self.center_x, self.center_y)
                    e.Display.DrawSprite(self.display_bmp, center, self.draw_w, self.draw_h)

            c = TrussPlotConduit()
            sc.sticky[CONDUIT_KEY] = c
            c.Enabled = True

        c = sc.sticky[CONDUIT_KEY]
        old_bmp = getattr(c, "bitmap_ref", None)
        if old_bmp is not None:
            try:
                old_bmp.Dispose()
            except Exception:
                pass

        # DrawSprite uses center; we want top-left at (MARGIN_LEFT, MARGIN_TOP)
        c.center_x = MARGIN_LEFT + draw_w * 0.5
        c.center_y = MARGIN_TOP + draw_h * 0.5
        c.draw_w = draw_w
        c.draw_h = draw_h
        c.display_bmp = display_bmp
        c.bitmap_ref = bmp
        c.visible = bool(show)

        doc = Rhino.RhinoDoc.ActiveDoc
        if doc is not None:
            doc.Views.Redraw()

        status = "{} | {}x{}px | {}".format(
            "VISIBLE" if show else "HIDDEN", int(draw_w), int(draw_h), resolved_path
        )
    except Exception as ex:
        status = "ERROR: {}".format(str(ex))
# ---------- end ttc_get_display_truss ----------

panel_2 = Panel(ttc_get_executor.status)
panel_3 = Panel(ttc_get_display_truss)

# ----
# Karamba Analysis Workflow
line_elements = Data(ttc_get_executor.Line_Elements)
crosec = Data(ttc_get_executor.CroSec)
support_points = Data(ttc_get_executor.Support)
loads = Data(ttc_get_executor.Loads)
load_points = Data(ttc_get_executor.Load_Points)

crosecselect = CrossSectionSelectorKaramba3D(NameOrListIndexOfCrossSection=crosec)  # -> flatten(CrossSection), Info
supp = SupportKaramba3D(PosInd=support_points, Ct_kN_m=Vector(0, 0, 0), Cr_kNm_rad=Vector(0, 0, 0), menu=[buttons(on, on, on, on, on, on)])  # -> flatten(Support)
loads_2 = LoadsKaramba3D(Vector=Vector(0, 0, -1), LCase="LC0", mode="Gravity")
loads_3 = LoadsKaramba3D(ForceVector=loads, Local=False, PosInd=load_points, LCase="LC0", mode="Point")
lineelem = CreateLinearElementKaramba3D(
    Line=line_elements,
    CrossSection=crosecselect.CrossSection,
    LimitDistance_m=0.005,
    BucklingLengthY_m=-1,
    BucklingLengthZ_m=-1,
    BucklingLengthLT_m=-1,
    Bending=True,
    ToPolylineMaxAngle=0.25,
    ToPolylineTolerance=0.1,
    ToPolylineMaxEdgeLength=0.25,
    New=True,
    Remove=True,
    mode="LineToBeam",
    GuidGeneratorSeed=-236662677)  # -> flatten(Element), Points, Info
merge = Merge(Data1=loads_3, Data2=loads_2)  # -> flatten(Result)

assemble = AssembleModelKaramba3D(Elem=lineelem.Element, Support=supp, Load=merge, LimitDistance_m=0.005)  # -> Model, Info, Mass_kg, CentreOfGravity, LoadCaseNames
analyse = AnalyseKaramba3D(Model=assemble.Model)  # -> AnalysedModel, MaximumDisplacement_cm, ResultingForce_kN, ChangeOfElasticEnergy_kNm
modelview = ModelViewKaramba3D(Model=analyse.AnalysedModel)  # -> Model, DeformedMesh, DeformedAxes, DeformedModel, MaximumDeformation

opticrosec = OptimizeCrossSectionKaramba3D(
    Model=assemble.Model,
    CrossSections=crosecrselect,
    MaximumUtilization=1,
    MaximumDisplacement_cm=-1,
    MaximumVirtualWork_kNcm=0.01,
    NumberOfUtilizationIterations=5,
    NumberOfDisplacementIterations=5,
    NumberOfDisplacementIncrementsPerIteration=2,
    DisplacementTolerance=0.01,
    NumberOfSamplePoints=3,
    ElasticDesign=True,
    GammaM0=1,
    GammaM1=1.1,
    SwayFrame=True)  # -> OptimizedModel, Info, Mass_kg, MaximumDisplacement_cm, ElasticEnergyChange_kNm, MaximumUtilizationViewInsufficientCrossSections, MaximumDisplacementViewLimitCrossSections

utilization = UtilizationOfElementsKaramba3D(
    AnalysedModel=modelview.Model,
    NumberOfSamplePoints=3,
    ElasticDesign=True,
    GammaM0=1,
    GammaM1=1.1,
    SwayFrame=True,
    WithDetails=False,
    mode="Beams")  # -> Model, Utilization, SigMax_kN_cm², SigMin_kN_cm², TauMax_kN_cm², UtilN, UtilVy, UtilVz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
beamview = BeamViewKaramba3D(Model=modelview.Model)  # -> Model, MeshesOfRenderedBeams, DeformedBeamAxes, LegendColours, LegendTags
b_forces = BeamForcesKaramba3D(AnalysedModel=modelview.Model, Ts=[0, 1])  # -> Model, NormalForce_kN, ShearForceVz_kN, ShearForceVy_kN, TorsionalMomentMt_kNm, BendingMomentMy_kNm, BendingMomentMz_kNm, LoadCaseIndex
beamdisp = BeamDisplacementsKaramba3D(AnalysedModel=modelview.Model, Ts=[0, 1])  # -> Model, Translations_m, Rotations_rad, LoadCaseIndex
vlen = VectorLength(Vector=beamdisp.Translations_m)  # -> simplify(Length)
legend = LegendKaramba3D(
    Colors=beamview.LegendColours,
    Tags=beamview.LegendTags,
    Scale=0.8,
    Textsize=30,
    Legend_HasHeader=False,
    Legend_Justification=2,
    Legend_Position=2)
item = ListItem(List=b_forces.NormalForce_kN, Index=0, Wrap=True)
item_2 = ListItem(List=vlen, Index=0, Wrap=True)  # -> Item, Item1

axial_forces = Data(flatten(item))
utilization_2 = Data(flatten(utilization.UtilN))
start = Data(flatten(item_2.Item))
end = Data(flatten(item_2.Item1))

ttc_post_analysis = Python3Script(
    run_id=ttc_get_executor.run_id,
    Line_Elements=line_elements,
    CroSec=crosec,
    Utilization=utilization_2,
    Displacement_Start=start,
    Displacement_End=end,
    Axial_Stress=axial_forces)  # -> status; inputs run_id: String, Line_Elements: list, CroSec: list, Utilization: list, Displacement_Start: list, Displacement_End: list, Axial_Stress: list
# ---------- ttc_post_analysis: Python ----------
# GH component: TTC Save Analysis
# Saves per-member analysis to run_output/[run_id]/analysis_output.json for the feedback loop.
# Input run_id + line_elements (base) + attribute lists → writes JSON, outputs run_id (pass-through).
#
# Input  run_id: str (or list with one str from GH wire)
# Input  Line_Elements: list of Rhino.Geometry.Line (or list of dicts {start, end, cross_section})
# Input  CroSec: list of str, cross_section name per member (same order as Line_Elements)
# Input  Utilization: list of float, one per member
# Input  Displacement_Start: list of [dx, dz] or Point3d/Vector3d, displacement at start of member
# Input  Displacement_End: list of [dx, dz] or Point3d/Vector3d, displacement at end of member
# Input  Axial_Stress: list of float, axial stress per member (e.g. MPa)
# Output run_id: str (same as input)
# Output status: str

import json
import os

REPO_ROOT = r"C:\Users\levin\Documents\GitHub\gh-text-to-code-ai-integration"
RUN_OUTPUT_DIR = os.path.join(REPO_ROOT, "03_python", "run_output")

try:
    import Rhino.Geometry as rg
except ImportError:
    rg = None


def _point_to_xz(pt):
    """Extract [x, z] from Point3d/Vector3d or [x, y, z] / [x, z] list."""
    if pt is None:
        return [0.0, 0.0]
    if rg and hasattr(pt, "X") and hasattr(pt, "Z"):
        return [float(pt.X), float(pt.Z)]
    if hasattr(pt, "__getitem__") and len(pt) >= 2:
        return [float(pt[0]), float(pt[1])]
    return [0.0, 0.0]


def _line_to_segment(line):
    """Convert Rhino Line to {start: [x,z], end: [x,z]}."""
    if rg and hasattr(line, "From") and hasattr(line, "To"):
        return {"start": _point_to_xz(line.From), "end": _point_to_xz(line.To)}
    if isinstance(line, dict):
        s, e = line.get("start"), line.get("end")
        return {"start": s if isinstance(s, list) else [0, 0], "end": e if isinstance(e, list) else [0, 0]}
    return {"start": [0.0, 0.0], "end": [0.0, 0.0]}


# Normalize run_id
if run_id is not None and hasattr(run_id, "__getitem__") and not isinstance(run_id, str):
    try:
        run_id = run_id[0]
    except (IndexError, TypeError, KeyError):
        run_id = ""
run_id = str(run_id).strip() if run_id else ""

# Coerce inputs to lists and ensure same length
line_elems = list(Line_Elements) if Line_Elements is not None else []
crosec = list(CroSec) if CroSec is not None else []
utilization = list(Utilization) if Utilization is not None else []
displacement_start = list(Displacement_Start) if Displacement_Start is not None else []
displacement_end = list(Displacement_End) if Displacement_End is not None else []
axial_stress = list(Axial_Stress) if Axial_Stress is not None else []

n = len(line_elems)
if n == 0:
    status = "No line elements provided; nothing to save."
else:
    # Align lengths to n (pad with defaults where needed)
    def pad(lst, default):
        return lst + [default] * (n - len(lst)) if len(lst) < n else lst[:n]

    crosec = pad(crosec, "")
    utilization = pad(utilization, 0.0)
    displacement_start = pad(displacement_start, [0.0, 0.0])
    displacement_end = pad(displacement_end, [0.0, 0.0])
    axial_stress = pad(axial_stress, 0.0)

    members = []
    for i in range(n):
        seg = _line_to_segment(line_elems[i])
        seg["cross_section"] = str(crosec[i]) if i < len(crosec) else ""
        seg["utilization"] = float(utilization[i])
        seg["displacement_start"] = _point_to_xz(displacement_start[i])
        seg["displacement_end"] = _point_to_xz(displacement_end[i])
        seg["axial_stress"] = float(axial_stress[i])
        members.append(seg)

    out = {
        "description": "Member analysis for feedback loop (per-member attributes)",
        "line_elements": members,
    }

    if not run_id:
        status = "No run_id provided; analysis not saved."
    else:
        run_dir = os.path.join(RUN_OUTPUT_DIR, run_id)
        try:
            os.makedirs(run_dir, exist_ok=True)
            path = os.path.join(run_dir, "analysis_output.json")
            with open(path, "w", encoding="utf-8") as f:
                json.dump(out, f, indent=2)
            status = "OK: saved " + path
        except Exception as err:
            status = "Error: " + str(err)
# ---------- end ttc_post_analysis ----------
panel_4 = Panel(ttc_post_analysis)

# ----
# Test Geometry
_01_test_geometry = _01_Test_Geometry()
load_point_selection = Load_Point_Selection(C=_01_test_geometry)
support_selection = Support_Selection(C=_01_test_geometry)
data = Data(_01_test_geometry)
data_2 = Data(support_selection)
data_3 = Data(load_point_selection)

lng = ListLength(List=load_point_selection)
neg = Negative(Value=Slider(50, range=0..100))
dup = DuplicateData(Data=neg, Number=lng, Order=True)
Z = UnitZ(Factor=dup)

loads_4 = Data(Z)

# ==== cluster _01_Test_Geometry
pipeline = GeometryPipeline(
    GroupByLayer=False,
    GroupByType=False,
    IncludeHidden=True,
    IncludeLocked=True,
    LayerFilter="01__Text Geometry",
    NameFilter="*",
    SublayerFiltering=True,
    TypeFilter=4)
split = SplitList(List=pipeline, Index="1")  # -> ListA, ListB
clx = CurveLine(Curve=split.ListA, Line=split.ListB)  # -> flatten(Points), flatten(Params), Count
cullpt = CullDuplicates(Points=clx.Points, Tolerance=0.1, CullMode=1)  # -> Points, Indices, Valence
item = ListItem(List=clx.Params, Index=cullpt.Indices, Wrap=True)
shatter = Shatter(Curve=split.ListA, Parameters=item)  # -> flatten(Segments)
explode = Explode(Curve=shatter, Recursive=True)  # -> flatten(Segments), Vertices
data = Data(split.ListB)
merge = Merge(Data1=explode.Segments, Data2=data)  # -> flatten(Line_Elements)
line_elements = ClusterOutput(merge)

# ==== cluster Load_Point_Selection
C = ClusterInput()
end = EndPoints(Curve=C)  # -> Start, End
merge = Merge(Data1=end.Start, Data2=end.End)  # -> flatten(Result)
rdpoints = RemoveDuplicatePointsKaramba3D(Point=merge, LimitDistance=0.005)  # -> OutPoint, Info, Indexes
pdecon = Deconstruct(Point=rdpoints.OutPoint)  # -> XComponent, YComponent, ZComponent
larger = LargerThan(FirstNumber=pdecon.ZComponent, SecondNumber=Slider(3.37, range=0..10))  # -> LargerThan, OrEqualTo
cull = CullPattern(List=rdpoints.OutPoint, CullPattern=larger.LargerThan)
loads_top_chord = ClusterOutput(cull)

# ==== cluster Support_Selection
C = ClusterInput()
end = EndPoints(Curve=C)  # -> Start, End
merge = Merge(Data1=end.Start, Data2=end.End)  # -> flatten(Result)
rdpoints = RemoveDuplicatePointsKaramba3D(Point=merge, LimitDistance=0.005)  # -> OutPoint, Info, Indexes
pdecon = Deconstruct(Point=rdpoints.OutPoint)  # -> XComponent, YComponent, ZComponent
larger = LargerThan(FirstNumber=pdecon.ZComponent, SecondNumber=Slider(3.37, range=0..10))  # -> LargerThan, OrEqualTo
cull = CullPattern(List=rdpoints.OutPoint, CullPattern=invert(larger.LargerThan))
pdecon_2 = Deconstruct(Point=cull)  # -> XComponent, YComponent, ZComponent
sort = SortList(Keys=pdecon_2.XComponent, ValuesA=cull)  # -> Keys, ValuesA
panel = Panel("""0
-1""")
item = ListItem(List=sort.ValuesA, Index=panel, Wrap=True)  # -> flatten(Item)
i = ClusterOutput(item)
